# Grasshopper definition Stripper_Dia1.gh (Grasshopper 1.0.7)
# plug-ins: Kangaroo2 Components, Weaverbird, Bifocals, Stripper, Ivy

subd = SubD(<subd referenced from the Rhino model>)
mesh_from_subd = MeshFromSubD(SubD=subd, Density=2)
combine_clean = CombineClean(Meshes=mesh_from_subd)
nakedvertices = NakedVertices(Mesh=combine_clean)  # -> ClothedIndex, NakedIndex, ClothedPts, NakedPts
point = Point(nakedvertices.NakedPts)
edgelengths = EdgeLengths(Mesh=combine_clean, LengthFactor=Slider(0, range=0..2), Strength=1)
anchor = Anchor(Point=point, Strength=10000)
show = Show(G=combine_clean)
merge = Merge(Data1=show, Data2=edgelengths, Data3=anchor)
bouncysolver = BouncySolver(GoalObjects=merge, Reset=Button(), Threshold=1e-15, Tolerance=0.0001, Damping=0.99, Iterations=10, On=Toggle(False))  # -> I, V, O
mesh = Mesh(bouncysolver.O)
clean_tree = CleanTree(RemoveNulls=True, RemoveInvalid=True, RemoveEmpty=False, Tree=mesh)
weaverbird_s_catmull_clark_subdivision = WeaverbirdsCatmullClarkSubdivision(MeshCurves=clean_tree, Level=Slider(0, range=0..3), SmoothNakedEdges=1)
mesh_2 = Mesh(weaverbird_s_catmull_clark_subdivision)
weaverbird_s_offset_mesh = WeaverbirdsOffsetMesh(MeshCurves=mesh_2, Distance=Slider(1.01, range=0..10), OffsetType=0)
get_mesh_topology_directionals = GetMeshTopologyDirectionals(Mesh=mesh_2, Order=True, Sort=False)  # -> UDirectionals, VDirectionals, SortedMesh
get_mesh_topology_directionals_2 = GetMeshTopologyDirectionals(Mesh=weaverbird_s_offset_mesh, Order=True, Sort=False)  # -> UDirectionals, VDirectionals, SortedMesh
curve = Curve(get_mesh_topology_directionals.UDirectionals)
strip_via_directionals = StripViaDirectionals(Mesh=mesh_2, PolylineDirectionals=curve)
curve_2 = Curve(get_mesh_topology_directionals_2.VDirectionals)
strip_via_directionals_2 = StripViaDirectionals(Mesh=weaverbird_s_offset_mesh, PolylineDirectionals=curve_2)
thinmesh = ThinMesh(MeshGraph=strip_via_directionals, Coefficient=Slider(0.77, range=0..1))  # -> OrigGraph, Mesh, ThinGraph
thinmesh_2 = ThinMesh(MeshGraph=strip_via_directionals_2, Coefficient=Slider(0.92, range=0..1))  # -> OrigGraph, Mesh, ThinGraph
custom_preview = CustomPreview(
    Geometry=thinmesh.Mesh,
    Material={diffuse=RGB(255, 0, 0), emission=RGB(0, 0, 0), shine=1, specular=RGB(255, 255, 255), transparency=0})
custom_preview_2 = CustomPreview(
    Geometry=thinmesh_2.Mesh,
    Material={diffuse=RGB(0, 0, 255), emission=RGB(0, 0, 0), shine=1, specular=RGB(255, 255, 255), transparency=0})
