# Grasshopper definition Stripper_Dia2.gh (Grasshopper 1.0.7)
# plug-ins: Kangaroo2 Components, Weaverbird, Bifocals, Stripper, Ivy, Pufferfish, MeshEdit Components, OpenNest

subd = SubD(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)
mesh_from_subd = MeshFromSubD(SubD=subd, Density=2)
combine_clean = CombineClean(Meshes=mesh_from_subd)
nakedvertices = NakedVertices(Mesh=combine_clean)  # -> ClothedIndex, NakedIndex, ClothedPts, NakedPts
point = Point(nakedvertices.NakedPts)
edgelengths = EdgeLengths(Mesh=combine_clean, LengthFactor=Slider(0, range=0..2), Strength=1)
anchor = Anchor(Point=point, Strength=10000)
show = Show(G=combine_clean)
merge = Merge(Data1=show, Data2=edgelengths, Data3=anchor)
bouncysolver = BouncySolver(GoalObjects=merge, Reset=Button(), Threshold=1e-15, Tolerance=0.0001, Damping=0.99, Iterations=10, On=Toggle(False))  # -> I, V, O
mesh = Mesh(bouncysolver.O)
clean_tree = CleanTree(RemoveNulls=True, RemoveInvalid=True, RemoveEmpty=False, Tree=mesh)
weaverbird_s_catmull_clark_subdivision = WeaverbirdsCatmullClarkSubdivision(MeshCurves=clean_tree, Level=Slider(1, range=0..3), SmoothNakedEdges=1)
mesh_2 = Mesh(weaverbird_s_catmull_clark_subdivision)
weaverbird_s_offset_mesh = WeaverbirdsOffsetMesh(MeshCurves=mesh_2, Distance=Slider(1.01, range=0..10), OffsetType=0)
get_mesh_topology_directionals = GetMeshTopologyDirectionals(Mesh=mesh_2, Order=True, Sort=False)  # -> UDirectionals, VDirectionals, SortedMesh
get_mesh_topology_directionals_2 = GetMeshTopologyDirectionals(Mesh=weaverbird_s_offset_mesh, Order=True, Sort=False)  # -> UDirectionals, VDirectionals, SortedMesh
curve = Curve(get_mesh_topology_directionals.UDirectionals)
strip_via_directionals = StripViaDirectionals(Mesh=mesh_2, PolylineDirectionals=curve)
curve_2 = Curve(get_mesh_topology_directionals_2.VDirectionals)
strip_via_directionals_2 = StripViaDirectionals(Mesh=weaverbird_s_offset_mesh, PolylineDirectionals=curve_2)
triangulate = Triangulate(Mesh=strip_via_directionals_2)  # -> Mesh, Count
graph_from_mesh = GraphFromMesh(InputMesh=triangulate.Mesh)
meshgraph_unroll = MeshGraphUnroll(MeshGraph=graft(graph_from_mesh), StartFace=-1, UnrollPlane=PlaneXY(0, 0, 0))  # -> Mesh, flatten(SplitMeshgraphs), flatten(SplitFlatGraphs), UnrollEdgeSplits
mesh_3 = Mesh(flatten(meshgraph_unroll.SplitFlatGraphs))
brec = BoundingRectangle(Geometry=graft(mesh_3), Plane=PlaneXY(0, 0, 0), Axis=0, Slide=0, Union=True)  # -> flatten(Bounding), flatten(DimensionX), flatten(DimensionY)
sort = SortList(Keys=brec.DimensionY)  # -> reverse(Keys), ValuesA
area = Area(Geometry=brec.Bounding)  # -> Area, Centroid
sort_2 = SortList(Keys=brec.DimensionX)  # -> reverse(Keys), ValuesA
lng = ListLength(List=mesh_3)
B = B(2)
item = ListItem(List=sort_2.Keys, Index=0, Wrap=True)
item_2 = ListItem(List=sort.Keys, Index=0, Wrap=True)
division = Division(A=lng, B=B)
thinmesh = ThinMesh(MeshGraph=strip_via_directionals, Coefficient=Slider(0.77, range=0..1))  # -> OrigGraph, Mesh, ThinGraph
thinmesh_2 = ThinMesh(MeshGraph=strip_via_directionals_2, Coefficient=Slider(0.92, range=0..1))  # -> OrigGraph, Mesh, ThinGraph
recgrid = Rectangular(Plane=PlaneXY(0, 30, 0), SizeX=item, SizeY=item_2, ExtentX=division, ExtentY=B)  # -> flatten(Cells), Points
custom_preview = CustomPreview(
    Geometry=thinmesh.Mesh,
    Material={diffuse=RGB(255, 0, 0), emission=RGB(0, 0, 0), shine=1, specular=RGB(255, 255, 255), transparency=0})
custom_preview_2 = CustomPreview(
    Geometry=thinmesh_2.Mesh,
    Material={diffuse=RGB(0, 0, 255), emission=RGB(0, 0, 0), shine=1, specular=RGB(255, 255, 255), transparency=0})
area_2 = Area(Geometry=recgrid.Cells)  # -> Area, Centroid
vec2pt = Vector2Pt(PointA=area.Centroid, PointB=area_2.Centroid, Unitize=False)  # -> Vector, Length
move = Move(Geometry=mesh_3, Motion=vec2pt.Vector)  # -> Geometry, Transform
area_3 = MeshArea(Mesh=move.Geometry)  # -> Area, Centroid
mesh_4 = Mesh(move.Geometry)
faceb = FaceBoundaries(Mesh=mesh_4)
faceb_2 = FaceBoundaries(Mesh=meshgraph_unroll.SplitMeshgraphs)
lng_2 = ListLength(List=flatten(mesh_4))
lng_3 = ListLength(List=faceb)
lng_4 = ListLength(List=faceb_2)
thin = ThinMesh(MeshGraph=move.Geometry, Coefficient=Slider(0.742, range=0..1))  # -> OrigGraph, Mesh, ThinGraph
item_3 = ListItem(List=faceb, Index=expr("x/2", lng_3), Wrap=True)
item_4 = ListItem(List=faceb_2, Index=expr("x/2", lng_4), Wrap=True)
series = Series(Start=0, Step=1, Count=lng_2)
wbnaked = WeaverbirdsNakedBoundary(MeshClosedPolylines=thin.Mesh)
int = Integer(series)
area_4 = MeshArea(Mesh=item_3)  # -> Area, Centroid
area_5 = MeshArea(Mesh=item_4)  # -> Area, Centroid
rectangle = Rectangle(Plane=graft(PlaneXY(0, 0, 0)), XSize=Domain(0, 20), YSize="30", Radius=0)  # -> Rectangle, Length
concat = Concatenate(FragmentA="M", FragmentB=int)
text = Text(Location=flatten(area_4.Centroid), Text=concat, Size=1)
tag = TextTag(Location=flatten(area_4.Centroid), Text=concat)
tag_2 = TextTag(Location=flatten(area_5.Centroid), Text=concat)
mesh_edges = MeshEdges(Mesh=thin.Mesh)  # -> NakedEdges, InteriorEdges, NonManifoldEdges
opennest = OpenNest(
    Sheets=rectangle.Rectangle,
    Geo=wbnaked,
    Spacing=".1",
    Placement=1,
    Tolerance=0.1,
    Rotations=4,
    Iterations="1",
    Seed=1,
    Reset=Button(),
    Run=Toggle(False))  # -> Sheets, Geo, ID, Transform, IDS
text_2 = Text(Location=flatten(area_4.Centroid), Text=concat, Size=0.2)
dam = DataDam(BufferDelay=10000000, BufferMode=0)
transform = Transform(Geometry=thin.Mesh, Transform=opennest.Transform)
curve_3 = Curve(mesh_edges.InteriorEdges)
weaverbird_s_naked_boundary = WeaverbirdsNakedBoundary(MeshClosedPolylines=transform)
transform_2 = Transform(Geometry=text_2, Transform=graft(opennest.Transform))
transform_3 = Transform(Geometry=curve_3, Transform=graft(opennest.Transform))
custom_preview_3 = CustomPreview(Geometry=transform_2, Material=ColourSwatch(SwatchColor=RGB(255, 255, 255)))
custom_preview_4 = CustomPreview(Geometry=transform_3, Material=ColourSwatch(SwatchColor=RGB(0, 0, 255)))
custom_preview_5 = CustomPreview(Geometry=weaverbird_s_naked_boundary, Material=ColourSwatch(SwatchColor=RGB(255, 0, 0)))
