# Grasshopper definition Stripper_Dia3.gh (Grasshopper 1.0.7)
# plug-ins: Kangaroo2 Components, Weaverbird, Bifocals, Stripper, Ivy, Pufferfish, MeshEdit Components, OpenNest

subd = SubD(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)
mesh_from_subd = MeshFromSubD(SubD=subd, Density=2)
combine_clean = CombineClean(Meshes=mesh_from_subd)
nakedvertices = NakedVertices(Mesh=combine_clean)  # -> ClothedIndex, NakedIndex, ClothedPts, NakedPts
point = Point(nakedvertices.NakedPts)
edgelengths = EdgeLengths(Mesh=combine_clean, LengthFactor=Slider(0, range=0..2), Strength=1)
anchor = Anchor(Point=point, Strength=10000)
show = Show(G=combine_clean)
merge = Merge(Data1=show, Data2=edgelengths, Data3=anchor)
bouncysolver = BouncySolver(GoalObjects=merge, Reset=Button(), Threshold=1e-15, Tolerance=0.0001, Damping=0.99, Iterations=10, On=Toggle(False))  # -> I, V, O
mesh = Mesh(bouncysolver.O)
clean_tree = CleanTree(RemoveNulls=True, RemoveInvalid=True, RemoveEmpty=False, Tree=mesh)
weaverbird_s_catmull_clark_subdivision = WeaverbirdsCatmullClarkSubdivision(MeshCurves=clean_tree, Level=Slider(1, range=0..3), SmoothNakedEdges=1)
mesh_2 = Mesh(weaverbird_s_catmull_clark_subdivision)
weaverbird_s_offset_mesh = WeaverbirdsOffsetMesh(MeshCurves=mesh_2, Distance=Slider(1.01, range=0..10), OffsetType=0)
triangulate = Triangulate(Mesh=weaverbird_s_offset_mesh)  # -> Mesh, Count
graph_from_mesh = GraphFromMesh(InputMesh=triangulate.Mesh)
get_mesh_topology_directionals = GetMeshTopologyDirectionals(Mesh=mesh_2, Order=True, Sort=False)  # -> UDirectionals, VDirectionals, SortedMesh
get_mesh_topology_directionals_2 = GetMeshTopologyDirectionals(Mesh=weaverbird_s_offset_mesh, Order=True, Sort=False)  # -> UDirectionals, VDirectionals, SortedMesh
curve = Curve(get_mesh_topology_directionals.UDirectionals)
graph_edges = GraphEdges(MeshGraph=graph_from_mesh)  # -> MeshId, GraphEdge, TopoEdge, flatten(Weight), Nodes, Angle, Bend
strip_via_directionals = StripViaDirectionals(Mesh=mesh_2, PolylineDirectionals=curve)
curve_2 = Curve(get_mesh_topology_directionals_2.VDirectionals)
curve_middle = CurveMiddle(Curve=graph_edges.TopoEdge)
strip_via_directionals_2 = StripViaDirectionals(Mesh=weaverbird_s_offset_mesh, PolylineDirectionals=curve_2)
triangulate_2 = Triangulate(Mesh=strip_via_directionals_2)  # -> Mesh, Count
graph_from_mesh_2 = GraphFromMesh(InputMesh=triangulate_2.Mesh)
graph_edges_2 = GraphEdges(MeshGraph=graph_from_mesh_2)  # -> MeshId, GraphEdge, TopoEdge, Weight, Nodes, Angle, Bend
curve_middle_2 = CurveMiddle(Curve=graph_edges_2.TopoEdge)  # -> flatten(Midpoint)
closest_point = ClosestPoint(Point=curve_middle, Cloud=curve_middle_2)  # -> ClosestPoint, CPIndex, Distance
larger_than = LargerThan(FirstNumber=closest_point.Distance, SecondNumber=0)  # -> LargerThan, OrEqualTo
integer = Integer(flatten(larger_than.LargerThan))
custom_edge_weight = CustomEdgeWeight(MeshGraph=graph_from_mesh, Weights=integer)
mst_kruskal = MSTKruskal(MeshGraph=custom_edge_weight)
weight_deviation_split_graph = WeightDeviationSplitGraph(MeshGraph=mst_kruskal, Deviation=0.5, MinFaces=20)
graft_tree = GraftTree(Tree=weight_deviation_split_graph, IncludeEmptyLists=True, IncludeNullItems=True)
meshgraph_unroll = MeshGraphUnroll(MeshGraph=graft_tree, StartFace=-1, UnrollPlane=PlaneXY(2.376150835, -49.71684654, 0))  # -> Mesh, SplitMeshgraphs, SplitFlatGraphs, UnrollEdgeSplits
edgetypes = EdgeTypes(MeshGraph=graft_tree)  # -> GraphEdges, CutEdges
panel = Panel(edgetypes.GraphEdges)
simpleflap = SimpleFlap(
    MeshGraph=graft_tree,
    Width=Slider(0.1, range=0..1),
    Bevel=Slider(0.05, range=0..1),
    Double=Toggle(False),
    MeshEdgeIndex=[edgetypes.CutEdges, meshgraph_unroll.UnrollEdgeSplits])  # -> simplify(Flap)
panel_2 = Panel(simpleflap)
flat_fabrication_multi = FlatFabricationMulti(
    SplitMeshgraphs=flatten(meshgraph_unroll.SplitMeshgraphs),
    SplitFlatGraphs=flatten(meshgraph_unroll.SplitFlatGraphs),
    Flaps=flatten(simpleflap),
    PieceLocation=PlaneXY(0, 0, 0),
    TextOffset=0.1)  # -> CutLines, FoldInLines, FoldOutLines, FlatLines, Text, PlaceHolders, InNodeCurves
text_tag_3d = TextTag3D(Location=flat_fabrication_multi.PlaceHolders, Text=flat_fabrication_multi.Text, Size=0.005, Justification=7)
curve_3 = Curve(flat_fabrication_multi.FoldInLines)
curve_4 = Curve(flat_fabrication_multi.FlatLines)
curve_5 = Curve(flat_fabrication_multi.FoldOutLines)
curve_6 = Curve(flat_fabrication_multi.CutLines)
shift_paths = ShiftPaths(Data=curve_3, Offset=-1)
shift_paths_2 = ShiftPaths(Data=curve_5, Offset=-1)
shift_paths_3 = ShiftPaths(Data=curve_4, Offset=-1)
shift_paths_4 = ShiftPaths(Data=curve_6, Offset=-1)
group = Group(Objects=shift_paths)
group_2 = Group(Objects=shift_paths_2)
group_3 = Group(Objects=shift_paths_3)
join_curves = JoinCurves(Curves=shift_paths_4, Preserve=False)
mesh_3 = Mesh(flatten(meshgraph_unroll.SplitFlatGraphs))
brec = BoundingRectangle(Geometry=mesh_3, Plane=PlaneXY(0, 0, 0), Axis=0, Slide=0, Union=True)  # -> Bounding, DimensionX, DimensionY
lng = ListLength(List=mesh_3)
B = B(2)
area = Area(Geometry=brec.Bounding)  # -> Area, Centroid
division = Division(A=lng, B=B)
thinmesh = ThinMesh(MeshGraph=strip_via_directionals, Coefficient=Slider(0.77, range=0..1))  # -> OrigGraph, Mesh, ThinGraph
thinmesh_2 = ThinMesh(MeshGraph=strip_via_directionals_2, Coefficient=Slider(0.92, range=0..1))  # -> OrigGraph, Mesh, ThinGraph
recgrid = Rectangular(Plane=PlaneXY(0, 30, 0), SizeX=brec.DimensionX, SizeY=brec.DimensionY, ExtentX=division, ExtentY=B)  # -> flatten(Cells), Points
custom_preview = CustomPreview(
    Geometry=thinmesh.Mesh,
    Material={diffuse=RGB(255, 0, 0), emission=RGB(0, 0, 0), shine=1, specular=RGB(255, 255, 255), transparency=0})
custom_preview_2 = CustomPreview(
    Geometry=thinmesh_2.Mesh,
    Material={diffuse=RGB(0, 0, 255), emission=RGB(0, 0, 0), shine=1, specular=RGB(255, 255, 255), transparency=0})
area_2 = Area(Geometry=recgrid.Cells)  # -> Area, Centroid
vec2pt = Vector2Pt(PointA=area.Centroid, PointB=area_2.Centroid, Unitize=False)  # -> Vector, Length
move = Move(Geometry=mesh_3, Motion=vec2pt.Vector)  # -> Geometry, Transform
move_2 = Move(Geometry=flatten(join_curves), Motion=vec2pt.Vector)  # -> Geometry, Transform
move_3 = Move(Geometry=flatten(group), Motion=vec2pt.Vector)  # -> Geometry, Transform
move_4 = Move(Geometry=flatten(group_2), Motion=vec2pt.Vector)  # -> Geometry, Transform
move_5 = Move(Geometry=flatten(group_3), Motion=vec2pt.Vector)  # -> Geometry, Transform
move_6 = Move(Geometry=mesh_3, Motion=vec2pt.Vector)  # -> Geometry, Transform
mesh_4 = Mesh(flatten(move_6.Geometry))
lng_2 = ListLength(List=flatten(mesh_4))
mesh_5 = Mesh(move.Geometry)
wheel = ColourWheel(
    lng_2,
    ColourGrips_Style=31,
    ColourGrips_Grip=[0.9487407427, 3.043135845, 5.137530948, 4.090333396],
    ColourGrips_Lum=[0, 1],
    ColourGrips_Range=[0.428635375, 0.428635375, 0.428635375, 0.428635375],
    ColourGrips_Sat=[0, 1])
faceb = FaceBoundaries(Mesh=mesh_5)
faceb_2 = FaceBoundaries(Mesh=meshgraph_unroll.SplitMeshgraphs)
lng_3 = ListLength(List=flatten(mesh_5))
lng_4 = ListLength(List=faceb)
lng_5 = ListLength(List=faceb_2)
item = ListItem(List=faceb, Index=expr("x/2", lng_4), Wrap=True)
item_2 = ListItem(List=faceb_2, Index=expr("x/2", lng_5), Wrap=True)
series = Series(Start=0, Step=1, Count=lng_3)
int = Integer(series)
area_3 = MeshArea(Mesh=item)  # -> Area, Centroid
area_4 = MeshArea(Mesh=item_2)  # -> Area, Centroid
concat = Concatenate(FragmentA="M", FragmentB=int)
rectangle = Rectangle(Plane=graft(PlaneXY(0, 0, 0)), XSize=Domain(0, 20), YSize="30", Radius=0)  # -> Rectangle, Length
preview = CustomPreview(Geometry=flatten(mesh_4), Material=wheel)
tag = TextTag(Location=flatten(area_4.Centroid), Text=concat)
text = Text(Location=flatten(area_3.Centroid), Text=concat, Size=0.25)
opennest = OpenNest(
    Sheets=rectangle.Rectangle,
    Geo=move_2.Geometry,
    Spacing=".1",
    Placement=1,
    Tolerance=0.1,
    Rotations=4,
    Iterations="1",
    Seed=1,
    Reset=Button(),
    Run=Toggle(False))  # -> Sheets, Geo, ID, Transform, IDS
transform = Transform(Geometry=text, Transform=graft(opennest.Transform))
transform_2 = Transform(Geometry=move_6.Geometry, Transform=opennest.Transform)
transform_3 = Transform(Geometry=move_3.Geometry, Transform=opennest.Transform)
transform_4 = Transform(Geometry=move_4.Geometry, Transform=opennest.Transform)
transform_5 = Transform(Geometry=move_5.Geometry, Transform=opennest.Transform)
mesh_6 = Mesh(flatten(transform_2))
custom_preview_3 = CustomPreview(Geometry=transform, Material=ColourSwatch(SwatchColor=RGB(255, 255, 255)))
custom_preview_4 = CustomPreview(Geometry=transform_5, Material=ColourSwatch(SwatchColor=RGB(255, 0, 255)))
custom_preview_5 = CustomPreview(Geometry=transform_4, Material=ColourSwatch(SwatchColor=RGB(19, 255, 255)))
lng_6 = ListLength(List=flatten(mesh_6))
custom_preview_6 = CustomPreview(Geometry=transform_3, Material=ColourSwatch(SwatchColor=RGB(255, 255, 255)))
wheel_2 = ColourWheel(
    lng_6,
    ColourGrips_Style=31,
    ColourGrips_Grip=[0.9487407427, 3.043135845, 5.137530948, 4.090333396],
    ColourGrips_Lum=[0, 1],
    ColourGrips_Range=[0.428635375, 0.428635375, 0.428635375, 0.428635375],
    ColourGrips_Sat=[0, 1])
preview_2 = CustomPreview(Geometry=flatten(mesh_6), Material=wheel_2)
