# Grasshopper definition Stripper_Dia3a.gh (Grasshopper 1.0.7)
# plug-ins: Ivy, Kangaroo2 Components, Weaverbird, Pufferfish, MeshEdit Components, OpenNest

subd = SubD(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)
mesh_from_subd = MeshFromSubD(SubD=subd, Density=2)
mesh = Mesh(mesh_from_subd)
triremesh = TriRemesh(Geometry=mesh, Iterations=25)  # -> Triangulation, Dual, Creases
grphmsh = GraphFromMesh(InputMesh=triremesh.Triangulation)
wboffset = WeaverbirdsOffsetMesh(MeshCurves=triremesh.Triangulation, Distance="1", OffsetType=0)
faweight = FaceAngleEdgeWeight(MeshGraph=grphmsh)
edges = GraphEdges(MeshGraph=faweight)  # -> MeshId, GraphEdge, TopoEdge, Weight, Nodes, Angle, Bend
grphmsh_2 = GraphFromMesh(InputMesh=wboffset)
expression = Expression(x=edges.Weight, Expression="1 - x")
mstk = MSTKruskal(MeshGraph=faweight)
cedgeweight = CustomEdgeWeight(MeshGraph=grphmsh_2, Weights=flatten(expression))
number_slider = Slider(21, range=0..100)
mstk_2 = MSTKruskal(MeshGraph=cedgeweight)
devsplit = WeightDeviationSplitGraph(MeshGraph=mstk_2, Deviation=0.5, MinFaces=number_slider)
devsplit_2 = WeightDeviationSplitGraph(MeshGraph=mstk, Deviation=0.5, MinFaces=number_slider)
number_slider_2 = Slider(0.834, range=0..1)
thin = ThinMesh(MeshGraph=devsplit, Coefficient=number_slider_2)  # -> OrigGraph, Mesh, ThinGraph
thin_2 = ThinMesh(MeshGraph=devsplit_2, Coefficient=number_slider_2)  # -> OrigGraph, Mesh, ThinGraph
meshgraph_unroll = MeshGraphUnroll(MeshGraph=thin_2.ThinGraph, StartFace=-1, UnrollPlane=PlaneXY(0, 0, 0))  # -> Mesh, SplitMeshgraphs, SplitFlatGraphs, UnrollEdgeSplits
face_boundaries = FaceBoundaries(Mesh=meshgraph_unroll.SplitFlatGraphs)
simpleflap = SimpleFlap(
    MeshGraph=graft(thin_2.ThinGraph),
    Width=Slider(0.1, range=0..0.1),
    Bevel=Slider(0.1, range=0..0.1),
    Double=False,
    MeshEdgeIndex=meshgraph_unroll.UnrollEdgeSplits)
explode = Explode(Curve=face_boundaries, Recursive=True)  # -> Segments, Vertices
list_length = ListLength(List=explode.Segments)
flat_fabrication_multi = FlatFabricationMulti(
    SplitMeshgraphs=meshgraph_unroll.SplitMeshgraphs,
    SplitFlatGraphs=meshgraph_unroll.SplitFlatGraphs,
    Flaps=simpleflap,
    PieceLocation=PlaneXY(0, 0, 0),
    TextOffset=0.1)  # -> CutLines, FoldInLines, FoldOutLines, FlatLines, Text, PlaceHolders, InNodeCurves
equality = Equality(FirstNumber=list_length, SecondNumber="3")  # -> Equality, Inequality
shift_paths = ShiftPaths(Data=equality.Equality, Offset=-1)
dispatch = Dispatch(List=face_boundaries, DispatchPattern=shift_paths)  # -> ListA, ListB
curve = Curve(flat_fabrication_multi.FlatLines)
curve_2 = Curve(flat_fabrication_multi.FoldInLines)
curve_3 = Curve(flat_fabrication_multi.FoldOutLines)
curve_4 = Curve(flat_fabrication_multi.CutLines)
curve_5 = Curve(dispatch.ListA)
control_polygon = ControlPolygon(Curve=curve_5)  # -> Polygon, Points
polygon_center = PolygonCenter(Polyline=curve_5)  # -> CenterV, CenterE, CenterA
shift_paths_2 = ShiftPaths(Data=curve_2, Offset=-1)
shift_paths_3 = ShiftPaths(Data=curve_3, Offset=-1)
shift_paths_4 = ShiftPaths(Data=curve, Offset=-1)
shift_paths_5 = ShiftPaths(Data=curve_4, Offset=-1)
plane_fit = PlaneFit(Points=control_polygon.Points)  # -> Plane, Deviation
group = Group(Objects=shift_paths_2)
group_2 = Group(Objects=shift_paths_3)
group_3 = Group(Objects=shift_paths_5)
group_4 = Group(Objects=shift_paths_4)
plane_origin = PlaneOrigin(Base=plane_fit.Plane, Origin=graft(polygon_center.CenterV))
circle = Circle(Plane=plane_origin, Radius=0.1)
mesh_2 = Mesh(flatten(meshgraph_unroll.SplitFlatGraphs))
brec = BoundingRectangle(Geometry=mesh_2, Plane=PlaneXY(0, 0, 0), Axis=0, Slide=0, Union=True)  # -> Bounding, DimensionX, DimensionY
lng = ListLength(List=mesh_2)
B = B(2)
area = Area(Geometry=brec.Bounding)  # -> Area, Centroid
division = Division(A=lng, B=B)
recgrid = Rectangular(Plane=PlaneXY(0, 30, 0), SizeX=brec.DimensionX, SizeY=brec.DimensionY, ExtentX=division, ExtentY=B)  # -> flatten(Cells), Points
area_2 = Area(Geometry=recgrid.Cells)  # -> Area, Centroid
vec2pt = Vector2Pt(PointA=area.Centroid, PointB=area_2.Centroid, Unitize=False)  # -> Vector, Length
move = Move(Geometry=mesh_2, Motion=vec2pt.Vector)  # -> Geometry, Transform
move_2 = Move(Geometry=flatten(group_3), Motion=vec2pt.Vector)  # -> Geometry, Transform
move_3 = Move(Geometry=flatten(group), Motion=vec2pt.Vector)  # -> Geometry, Transform
move_4 = Move(Geometry=flatten(group_2), Motion=vec2pt.Vector)  # -> Geometry, Transform
move_5 = Move(Geometry=flatten(group_4), Motion=vec2pt.Vector)  # -> Geometry, Transform
move_6 = Move(Geometry=mesh_2, Motion=vec2pt.Vector)  # -> Geometry, Transform
mesh_3 = Mesh(flatten(move_6.Geometry))
lng_2 = ListLength(List=flatten(mesh_3))
mesh_4 = Mesh(move.Geometry)
wheel = ColourWheel(
    lng_2,
    ColourGrips_Style=31,
    ColourGrips_Grip=[0.9487407427, 3.043135845, 5.137530948, 4.090333396],
    ColourGrips_Lum=[0, 1],
    ColourGrips_Range=[0.428635375, 0.428635375, 0.428635375, 0.428635375],
    ColourGrips_Sat=[0, 1])
faceb = FaceBoundaries(Mesh=mesh_4)
faceb_2 = FaceBoundaries(Mesh=meshgraph_unroll.SplitMeshgraphs)
lng_3 = ListLength(List=flatten(mesh_4))
lng_4 = ListLength(List=faceb)
lng_5 = ListLength(List=faceb_2)
item = ListItem(List=faceb, Index=expr("x/2", lng_4), Wrap=True)
item_2 = ListItem(List=faceb_2, Index=expr("x/2", lng_5), Wrap=True)
series = Series(Start=0, Step=1, Count=lng_3)
int = Integer(series)
area_3 = MeshArea(Mesh=item)  # -> Area, Centroid
area_4 = MeshArea(Mesh=item_2)  # -> Area, Centroid
concat = Concatenate(FragmentA="M", FragmentB=int)
rectangle = Rectangle(Plane=graft(PlaneXY(0, 0, 0)), XSize=Domain(0, 20), YSize="30", Radius=0)  # -> Rectangle, Length
preview = CustomPreview(Geometry=flatten(mesh_3), Material=wheel)
tag = TextTag(Location=flatten(area_4.Centroid), Text=concat)
text = Text(Location=flatten(area_3.Centroid), Text=concat, Size=0.25)
opennest = OpenNest(
    Sheets=rectangle.Rectangle,
    Geo=move_6.Geometry,
    Spacing=".1",
    Placement=1,
    Tolerance=0.1,
    Rotations=4,
    Iterations="1",
    Seed=1,
    Reset=Button(),
    Run=Toggle(False))  # -> Sheets, Geo, ID, Transform, IDS
face_boundaries_2 = FaceBoundaries(Mesh=opennest.Geo)
transform = Transform(Geometry=text, Transform=graft(opennest.Transform))
transform_2 = Transform(Geometry=move_6.Geometry, Transform=opennest.Transform)
transform_3 = Transform(Geometry=move_3.Geometry, Transform=opennest.Transform)
transform_4 = Transform(Geometry=move_4.Geometry, Transform=opennest.Transform)
transform_5 = Transform(Geometry=move_5.Geometry, Transform=opennest.Transform)
explode_2 = Explode(Curve=face_boundaries_2, Recursive=True)  # -> Segments, Vertices
list_length_2 = ListLength(List=explode_2.Segments)
equality_2 = Equality(FirstNumber=list_length_2, SecondNumber="3")  # -> Equality, Inequality
mesh_5 = Mesh(flatten(transform_2))
custom_preview = CustomPreview(Geometry=transform, Material=ColourSwatch(SwatchColor=RGB(255, 255, 255)))
custom_preview_2 = CustomPreview(Geometry=transform_5, Material=ColourSwatch(SwatchColor=RGB(255, 0, 255)))
custom_preview_3 = CustomPreview(Geometry=transform_4, Material=ColourSwatch(SwatchColor=RGB(19, 255, 255)))
lng_6 = ListLength(List=flatten(mesh_5))
custom_preview_4 = CustomPreview(Geometry=transform_3, Material=ColourSwatch(SwatchColor=RGB(255, 255, 255)))
shift_paths_6 = ShiftPaths(Data=equality_2.Equality, Offset=-1)
wheel_2 = ColourWheel(
    lng_6,
    ColourGrips_Style=31,
    ColourGrips_Grip=[0.9487407427, 3.043135845, 5.137530948, 4.090333396],
    ColourGrips_Lum=[0, 1],
    ColourGrips_Range=[0.428635375, 0.428635375, 0.428635375, 0.428635375],
    ColourGrips_Sat=[0, 1])
dispatch_2 = Dispatch(List=face_boundaries_2, DispatchPattern=shift_paths_6)  # -> ListA, ListB
curve_6 = Curve(dispatch_2.ListA)
control_polygon_2 = ControlPolygon(Curve=curve_6)  # -> Polygon, Points
polygon_center_2 = PolygonCenter(Polyline=curve_6)  # -> CenterV, CenterE, CenterA
preview_2 = CustomPreview(Geometry=flatten(mesh_5), Material=wheel_2)
plane_fit_2 = PlaneFit(Points=control_polygon_2.Points)  # -> Plane, Deviation
plane_origin_2 = PlaneOrigin(Base=plane_fit_2.Plane, Origin=graft(polygon_center_2.CenterV))
circle_2 = Circle(Plane=plane_origin_2, Radius=0.1)
