# Grasshopper definition Stripping_1.gh (Grasshopper 1.0.7)
# plug-ins: Weaverbird, Kangaroo2 Components

subd = SubD(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)
meshsubd = MeshFromSubD(SubD=subd, Density="1")
wbcatmullclark = WeaverbirdsCatmullClarkSubdivision(MeshCurves=meshsubd, Level=Slider(2, range=0..10), SmoothNakedEdges=1)
nv = NakedVertices(Mesh=wbcatmullclark)  # -> ClothedIndex, NakedIndex, ClothedPts, NakedPts
pt = Point(nv.NakedPts)
edgelengths = EdgeLengths(Mesh=wbcatmullclark, LengthFactor=Slider(0, range=0..1), Strength=1)
anchor = Anchor(Point=pt, Strength=10000)
show = Show(G=wbcatmullclark)
bouncysolver = BouncySolver(
    GoalObjects=[edgelengths, anchor, show],
    Reset=Button(),
    Threshold=1e-15,
    Tolerance=0.0001,
    Damping=0.99,
    Iterations=10,
    On=Toggle(False))  # -> I, V, O
mesh = Mesh(bouncysolver.O)
clean = CleanTree(RemoveNulls=True, RemoveInvalid=True, RemoveEmpty=False, Tree=mesh)
