# Grasshopper definition Stripping_2.gh (Grasshopper 1.0.7)
# plug-ins: Stripper, Weaverbird, Kangaroo2 Components

subd = SubD(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)
subd_2 = SubD(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)
subd_3 = SubD(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)
subd_4 = SubD(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)
meshsubd = MeshFromSubD(SubD=subd, Density="1")
meshsubd_2 = MeshFromSubD(SubD=subd_4, Density="1")
wbcatmullclark = WeaverbirdsCatmullClarkSubdivision(MeshCurves=meshsubd, Level=Slider(2, range=0..10), SmoothNakedEdges=1)
mesh = Mesh(wbcatmullclark)
wbcatmullclark_2 = WeaverbirdsCatmullClarkSubdivision(MeshCurves=meshsubd_2, Level=Slider(2, range=0..10), SmoothNakedEdges=1)

# ---- group: Stripping
dam = DataDam(DataA=mesh, BufferDelay=10000000, BufferMode=0)
topo_dir = GetMeshTopologyDirectionals(Mesh=dam, Order=True, Sort=False)  # -> UDirectionals, VDirectionals, SortedMesh
crv = Curve(topo_dir.VDirectionals)
dir_strips = StripViaDirectionals(Mesh=topo_dir.SortedMesh, PolylineDirectionals=crv)

# ----
nv = NakedVertices(Mesh=wbcatmullclark_2)  # -> ClothedIndex, NakedIndex, ClothedPts, NakedPts
pt = Point(nv.NakedPts)
edgelengths = EdgeLengths(Mesh=wbcatmullclark_2, LengthFactor=Slider(0, range=0..1), Strength=1)
anchor = Anchor(Point=pt, Strength=10000)
show = Show(G=wbcatmullclark_2)
bouncysolver = BouncySolver(
    GoalObjects=[edgelengths, anchor, show],
    Reset=Button(),
    Threshold=1e-15,
    Tolerance=0.0001,
    Damping=0.99,
    Iterations=10,
    On=Toggle(False))  # -> I, V, O
mesh_2 = Mesh(bouncysolver.O)
wbnaked = WeaverbirdsNakedBoundary(MeshClosedPolylines=dir_strips)
clean = CleanTree(RemoveNulls=True, RemoveInvalid=True, RemoveEmpty=False, Tree=mesh_2)
mesh_3 = Mesh(clean)

# ---- group: Stripping
dam_2 = DataDam(DataA=mesh_3, BufferDelay=10000000, BufferMode=0)
topo_dir_2 = GetMeshTopologyDirectionals(Mesh=dam_2, Order=True, Sort=False)  # -> UDirectionals, VDirectionals, SortedMesh
crv_2 = Curve(topo_dir_2.UDirectionals)
dir_strips_2 = StripViaDirectionals(Mesh=topo_dir_2.SortedMesh, PolylineDirectionals=crv_2)

# ----
wbnaked_2 = WeaverbirdsNakedBoundary(MeshClosedPolylines=dir_strips_2)
preview = CustomPreview(Geometry=dir_strips_2, Material=ColourSwatch(SwatchColor=RGB(245, 5, 5)))
preview_2 = CustomPreview(Geometry=wbnaked_2, Material=ColourSwatch(SwatchColor=RGB(0, 0, 0)))
preview_3 = CustomPreview(Geometry=dir_strips, Material=ColourSwatch(SwatchColor=RGB(245, 5, 5)))
preview_4 = CustomPreview(Geometry=wbnaked, Material=ColourSwatch(SwatchColor=RGB(0, 0, 0)))
