# Grasshopper definition Stripping_3.gh (Grasshopper 1.0.7)
# plug-ins: Stripper, Weaverbird, Ivy, Kangaroo2 Components

subd = SubD(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)
meshsubd = MeshFromSubD(SubD=subd, Density="1")
wbcatmullclark = WeaverbirdsCatmullClarkSubdivision(MeshCurves=meshsubd, Level=Slider(2, range=0..10), SmoothNakedEdges=1)
nv = NakedVertices(Mesh=wbcatmullclark)  # -> ClothedIndex, NakedIndex, ClothedPts, NakedPts
pt = Point(nv.NakedPts)
edgelengths = EdgeLengths(Mesh=wbcatmullclark, LengthFactor=Slider(0, range=0..1), Strength=1)
anchor = Anchor(Point=pt, Strength=10000)
show = Show(G=wbcatmullclark)
bouncysolver = BouncySolver(
    GoalObjects=[edgelengths, anchor, show],
    Reset=Button(),
    Threshold=1e-15,
    Tolerance=0.0001,
    Damping=0.99,
    Iterations=10,
    On=Toggle(False))  # -> I, V, O
number_slider = Slider(0.94, range=0..1)
mesh = Mesh(bouncysolver.O)
clean = CleanTree(RemoveNulls=True, RemoveInvalid=True, RemoveEmpty=False, Tree=mesh)
mesh_2 = Mesh(clean)
dam = DataDam(DataA=mesh_2, BufferDelay=10000000, BufferMode=0)
wboffset = WeaverbirdsOffsetMesh(MeshCurves=dam, Distance=Slider(0.5, range=0..1), OffsetType=0)
topo_dir = GetMeshTopologyDirectionals(Mesh=wboffset, Order=True, Sort=False)  # -> UDirectionals, VDirectionals, SortedMesh
topo_dir_2 = GetMeshTopologyDirectionals(Mesh=dam, Order=True, Sort=False)  # -> UDirectionals, VDirectionals, SortedMesh
crv = Curve(topo_dir.VDirectionals)
crv_2 = Curve(topo_dir_2.UDirectionals)
dir_strips = StripViaDirectionals(Mesh=topo_dir.SortedMesh, PolylineDirectionals=crv)
dir_strips_2 = StripViaDirectionals(Mesh=topo_dir_2.SortedMesh, PolylineDirectionals=crv_2)
thin = ThinMesh(MeshGraph=dir_strips, Coefficient=number_slider)  # -> OrigGraph, Mesh, ThinGraph
thin_2 = ThinMesh(MeshGraph=dir_strips_2, Coefficient=number_slider)  # -> OrigGraph, Mesh, ThinGraph
preview = CustomPreview(Geometry=thin.Mesh, Material=ColourSwatch(SwatchColor=RGB(5, 73, 245)))
preview_2 = CustomPreview(Geometry=thin_2.Mesh, Material=ColourSwatch(SwatchColor=RGB(245, 5, 5)))
