# Grasshopper definition Stripping_4.gh (Grasshopper 1.0.7)
# plug-ins: Stripper, Ivy, Kangaroo2 Components

mesh = Mesh(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)
triremesh = TriRemesh(Geometry=mesh, Iterations=25)  # -> Triangulation, Dual, Creases
grphmsh = GraphFromMesh(InputMesh=triremesh.Triangulation)
faweight = FaceAngleEdgeWeight(MeshGraph=grphmsh)
mstk = MSTKruskal(MeshGraph=faweight)
devsplit = WeightDeviationSplitGraph(MeshGraph=mstk, Deviation=0.5, MinFaces=Slider(21, range=0..100))
thin = ThinMesh(MeshGraph=devsplit, Coefficient=Slider(0.86, range=0..1))  # -> OrigGraph, Mesh, ThinGraph
color_meshes = ColorMeshesRandomly(M=thin.Mesh, Rs=5, Re=250, Gs=5, Ge=250, Bs=5, Be=250)
