# Grasshopper definition Stripping_5.gh (Grasshopper 1.0.7)
# plug-ins: Ivy, Kangaroo2 Components, Weaverbird

mesh = Mesh(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)
triremesh = TriRemesh(Geometry=mesh, Iterations=25)  # -> Triangulation, Dual, Creases
grphmsh = GraphFromMesh(InputMesh=triremesh.Triangulation)
wboffset = WeaverbirdsOffsetMesh(MeshCurves=triremesh.Triangulation, Distance="1", OffsetType=0)
faweight = FaceAngleEdgeWeight(MeshGraph=grphmsh)
edges = GraphEdges(MeshGraph=faweight)  # -> MeshId, GraphEdge, TopoEdge, Weight, Nodes, Angle, Bend
grphmsh_2 = GraphFromMesh(InputMesh=wboffset)
expression = Expression(x=edges.Weight, Expression="1 - x")
mstk = MSTKruskal(MeshGraph=faweight)
cedgeweight = CustomEdgeWeight(MeshGraph=grphmsh_2, Weights=flatten(expression))
number_slider = Slider(21, range=0..100)
mstk_2 = MSTKruskal(MeshGraph=cedgeweight)
devsplit = WeightDeviationSplitGraph(MeshGraph=mstk_2, Deviation=0.5, MinFaces=number_slider)
devsplit_2 = WeightDeviationSplitGraph(MeshGraph=mstk, Deviation=0.5, MinFaces=number_slider)
number_slider_2 = Slider(0.834, range=0..1)
thin = ThinMesh(MeshGraph=devsplit, Coefficient=number_slider_2)  # -> OrigGraph, Mesh, ThinGraph
thin_2 = ThinMesh(MeshGraph=devsplit_2, Coefficient=number_slider_2)  # -> OrigGraph, Mesh, ThinGraph
preview = CustomPreview(Geometry=thin_2.Mesh, Material=ColourSwatch(SwatchColor=RGB(245, 5, 5)))
preview_2 = CustomPreview(Geometry=thin.Mesh, Material=ColourSwatch(SwatchColor=RGB(5, 73, 245)))
