# Grasshopper definition unrolling1.gh (Grasshopper 1.0.7)
# plug-ins: Ivy, Weaverbird, Kangaroo2 Components

subd = SubD(<subd referenced from the Rhino model>)
mesh_from_subd = MeshFromSubD(SubD=subd, Density=2)
combine_clean = CombineClean(Meshes=mesh_from_subd)
mesh = Mesh(combine_clean)
grphmsh = GraphFromMesh(InputMesh=mesh)
graph_edges = GraphEdges(MeshGraph=grphmsh)  # -> MeshId, GraphEdge, TopoEdge, flatten(Weight), Nodes, Angle, Bend
nakedvertices = NakedVertices(Mesh=grphmsh)  # -> ClothedIndex, NakedIndex, ClothedPts, NakedPts
orange_peel_edges = OrangePEELEdges(MeshGraph=grphmsh, StartVertices=nakedvertices.NakedIndex)
replace_items = ReplaceItems(List=graph_edges.Weight, Item="1", Indices=orange_peel_edges, Wrap=False)
custom_edge_weight = CustomEdgeWeight(MeshGraph=grphmsh, Weights=replace_items)
edges = GraphEdges(MeshGraph=custom_edge_weight)  # -> MeshId, GraphEdge, TopoEdge, Weight, Nodes, Angle, Bend
wboffset = WeaverbirdsOffsetMesh(MeshCurves=mesh, Distance="1", OffsetType=0)
expression = Expression(x=edges.Weight, Expression="1 - x")
grphmsh_2 = GraphFromMesh(InputMesh=wboffset)
cedgeweight = CustomEdgeWeight(MeshGraph=grphmsh_2, Weights=flatten(expression))
number_slider = Slider(71, range=0..100)
mstk = MSTKruskal(MeshGraph=cedgeweight)
mstk_2 = MSTKruskal(MeshGraph=custom_edge_weight)
devsplit = WeightDeviationSplitGraph(MeshGraph=mstk, Deviation=0.5, MinFaces=number_slider)
number_slider_2 = Slider(0.463, range=0..1)
devsplit_2 = WeightDeviationSplitGraph(MeshGraph=mstk_2, Deviation="0.5", MinFaces=number_slider)
thin = ThinMesh(MeshGraph=devsplit, Coefficient=number_slider_2)  # -> OrigGraph, Mesh, ThinGraph
thin_2 = ThinMesh(MeshGraph=devsplit_2, Coefficient=number_slider_2)  # -> OrigGraph, Mesh, ThinGraph
preview = CustomPreview(Geometry=thin.Mesh, Material=ColourSwatch(SwatchColor=RGB(5, 73, 245)))
preview_2 = CustomPreview(Geometry=thin_2.Mesh, Material=ColourSwatch(SwatchColor=RGB(245, 5, 5)))
