# Grasshopper definition unrolling3.gh (Grasshopper 1.0.7)
# plug-ins: Ivy, Kangaroo2 Components, Pufferfish, MeshEdit Components, OpenNest, Weaverbird

subd = SubD(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)
meshsubd = MeshFromSubD(SubD=subd, Density=2)
clean = CombineClean(Meshes=meshsubd)
tri = Triangulate(Mesh=clean)  # -> Mesh, Count
mesh = Mesh(tri.Mesh)
grphmsh = GraphFromMesh(InputMesh=mesh)
nv = NakedVertices(Mesh=grphmsh)  # -> ClothedIndex, NakedIndex, ClothedPts, NakedPts
edges = GraphEdges(MeshGraph=grphmsh)  # -> MeshId, GraphEdge, TopoEdge, flatten(Weight), Nodes, Angle, Bend
ope = OrangePEELEdges(MeshGraph=grphmsh, StartVertices=nv.NakedIndex)
replace = ReplaceItems(List=edges.Weight, Item="1", Indices=ope, Wrap=False)
cedgeweight = CustomEdgeWeight(MeshGraph=grphmsh, Weights=replace)
mstk = MSTKruskal(MeshGraph=cedgeweight)
devsplit = WeightDeviationSplitGraph(MeshGraph=mstk, Deviation="0.5", MinFaces=Slider(8, range=0..100))
mguroll = MeshGraphUnroll(MeshGraph=devsplit, StartFace=-1, UnrollPlane=PlaneXY(0, 0, 0))  # -> Mesh, SplitMeshgraphs, SplitFlatGraphs, UnrollEdgeSplits
mesh_2 = Mesh(mguroll.SplitMeshgraphs)
faceb = FaceBoundaries(Mesh=mesh_2)
lng = ListLength(List=flatten(mesh_2))
lng_2 = ListLength(List=faceb)
item = ListItem(List=faceb, Index=expr("x/2", lng_2), Wrap=True)
series = Series(Start=0, Step=1, Count=lng)
int = Integer(series)
area = MeshArea(Mesh=item)  # -> Area, Centroid
concat = Concatenate(FragmentA="M", FragmentB=int)
tag = TextTag(Location=flatten(area.Centroid), Text=concat)
lng_3 = ListLength(List=flatten(mguroll.SplitMeshgraphs))
wheel = ColourWheel(
    lng_3,
    ColourGrips_Style=31,
    ColourGrips_Grip=[0.9487407427, 3.043135845, 5.137530948, 4.090333396],
    ColourGrips_Lum=[0, 1],
    ColourGrips_Range=[0.428635375, 0.428635375, 0.428635375, 0.428635375],
    ColourGrips_Sat=[0, 1])
demesh = DeconstructMesh(Mesh=mguroll.SplitMeshgraphs)  # -> Vertices, Faces, Colours, Normals
mesh_3 = Mesh(flatten(mguroll.SplitFlatGraphs))
grph2msh = GraphToMesh(MeshGraph=mguroll.SplitMeshgraphs)
preview = CustomPreview(Geometry=flatten(grph2msh), Material=wheel)
brec = BoundingRectangle(Geometry=graft(mesh_3), Plane=PlaneXY(0, 0, 0), Axis=0, Slide=0, Union=True)  # -> flatten(Bounding), flatten(DimensionX), flatten(DimensionY)
sort = SortList(Keys=brec.DimensionY)  # -> reverse(Keys), ValuesA
area_2 = Area(Geometry=brec.Bounding)  # -> Area, Centroid
sort_2 = SortList(Keys=brec.DimensionX)  # -> reverse(Keys), ValuesA
lng_4 = ListLength(List=mesh_3)
B = B(2)
item_2 = ListItem(List=sort_2.Keys, Index=0, Wrap=True)
item_3 = ListItem(List=sort.Keys, Index=0, Wrap=True)
division = Division(A=lng_4, B=B)
recgrid = Rectangular(Plane=PlaneXY(0, 30, 0), SizeX=item_2, SizeY=item_3, ExtentX=division, ExtentY=B)  # -> flatten(Cells), Points
area_3 = Area(Geometry=recgrid.Cells)  # -> Area, Centroid
vec2pt = Vector2Pt(PointA=area_2.Centroid, PointB=area_3.Centroid, Unitize=False)  # -> Vector, Length
move = Move(Geometry=mesh_3, Motion=vec2pt.Vector)  # -> Geometry, Transform
preview_2 = CustomPreview(Geometry=flatten(move.Geometry), Material=wheel)
area_4 = MeshArea(Mesh=move.Geometry)  # -> Area, Centroid
mesh_4 = Mesh(move.Geometry)
faceb_2 = FaceBoundaries(Mesh=mesh_4)
lng_5 = ListLength(List=flatten(mesh_4))
lng_6 = ListLength(List=faceb_2)
thin = ThinMesh(MeshGraph=move.Geometry, Coefficient=Slider(0.742, range=0..1))  # -> OrigGraph, Mesh, ThinGraph
item_4 = ListItem(List=faceb_2, Index=expr("x/2", lng_6), Wrap=True)
series_2 = Series(Start=0, Step=1, Count=lng_5)
wbnaked = WeaverbirdsNakedBoundary(MeshClosedPolylines=thin.Mesh)
int_2 = Integer(series_2)
area_5 = MeshArea(Mesh=item_4)  # -> Area, Centroid
concat_2 = Concatenate(FragmentA="M", FragmentB=int_2)
rectangle = Rectangle(Plane=PlaneXY(0, 0, 0), XSize=Domain(0, 20), YSize=Domain(0, 20), Radius=0)  # -> Rectangle, Length
tag_2 = TextTag(Location=flatten(area_5.Centroid), Text=concat_2)
text = Text(Location=flatten(area_5.Centroid), Text=concat_2, Size=1)
opennest = OpenNest(
    Sheets=rectangle.Rectangle,
    Geo=wbnaked,
    Spacing=".1",
    Placement=1,
    Tolerance=0.1,
    Rotations="8",
    Iterations="10",
    Seed=1,
    Reset=Button(),
    Run=Toggle(False))  # -> Sheets, Geo, ID, Transform, IDS
text_2 = Text(Location=flatten(area_5.Centroid), Text=concat_2, Size=1)
dam = DataDam(BufferDelay=10000000, BufferMode=0)
crv = Curve(opennest.Geo)
transform = Transform(Geometry=text_2, Transform=graft(opennest.Transform))
